# Grasshopper definition simgame.gh (Grasshopper 1.0.7)
# plug-ins: MeshEdit Components, Pufferfish, Bombyx 2, Wombat

# ---- group: north
point = Point(Point(-0.5, 0, 0))

# ---- group: desk vectors
curve = Curve(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)

# ----
selected_number_of_windows = Slider(5, range=0..6)

# ---- group: window dimensions
div_window_width = Slider(0.9, range=0.3..3)
window_height = Slider(1.2, range=0.6..4)
window_base_h = Slider(0.9, range=0..1.8)

# ----
frame_depth = Slider(0.2, range=0..0.5)
frame_width = Slider(0.1, range=0.01..0.4)

# ----
# desks and cabinets
desk_height = Slider(0.8, range=0.6..1)
cabinet_height = Slider(1.3, range=0.6..2.2)

# ----
# windows
preset = Slider(2, range=0..3)

# ---- group: north placement
north_placement = MDSlider(
    SliderMode=0,
    slider_value=Point(0.4035259947, 0.3860473633, 0.5),
    x_domain=Domain(-5, 5),
    y_domain=Domain(-5, 5),
    z_domain=Domain(0, 1))

# ----
# room
room_height = Slider(3.1, range=2.2..5)
wall_thickness = Slider(0.4, range=0.1..1)
int_wall_width = Slider(0.2, range=0.1..0.6)

font_size = Slider(1, range=0..10)
# north
sign_size = Slider(0.64, range=0..1)
arrow_thickness = Slider(0.075, range=0..0.1)

# ---- group: RH_IN:RoomNumber
number_slider = Slider(1, range=1..5)

# ----
curve_2 = Curve()

# ---- group: cabinets
curve_3 = Curve()

# ---- group: desks
curve_4 = Curve(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)

# ---- group: walls interior
curve_5 = Curve()

# ---- group: walls exterior
curve_6 = Curve(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)

# ----
curve_7 = Curve(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)

# ---- group: active area
curve_8 = Curve(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)

# ----
curve_9 = Curve(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)
merge = Merge(Data1=curve_6, Data2=curve_9, Data3=curve_7)
list_item = ListItem(List=merge, Index=number_slider, Wrap=True)

# ---- group: window placement / RH_IN:window1
window_1 = Slider(1, range=0..15)

# ---- group: window placement / RH_IN:window2
window_2 = Slider(3, range=0..15)

# ----
window_7 = Slider(0, range=0..16)
window_6 = Slider(0, range=0..16)

# ---- group: window placement / RH_IN:window3
window_3 = Slider(5, range=0..15)

# ---- group: window placement
window_4 = Slider(0, range=0..15)
window_5 = Slider(0, range=0..15)
relay = Relay([window_5, window_4, window_3, window_2, window_1, window_6, window_7])

# ----
# Preset format:
# 1. base height
# 2. width
# 3. height
panel = Panel("""0.9
0.8
1.4""")
panel_2 = Panel("""0.9
0.9
1.3""")
panel_3 = Panel("""0.9
0.7
1.2""")
panel_4 = Panel("""0
1.135
2.135""")
merge_2 = Merge(Data1=graft(panel_3), Data2=graft(panel), Data3=graft(panel_2), Data4=graft(panel_4))
flip_matrix = FlipMatrix(Data=merge_2)  # -> simplify(Data)
tree_branch = TreeBranch(Tree=flip_matrix, Path=preset, MaintainPaths=True)

merge_3 = Merge(Data1=window_base_h, Data2=div_window_width, Data3=window_height)

# ---- group: north angle from point
unit_y = UnitY(Factor=1)
vector_2pt = Vector2Pt(PointA="0,0,0", PointB=point, Unitize=False)  # -> Vector, Length
xy_plane = XYPlane(Origin=Point(0, 0, 0))
angle = Angle(VectorA=unit_y, VectorB=vector_2pt.Vector, Plane=xy_plane)  # -> Angle, Reflex
degrees = Degrees(Radians=angle.Angle)

# ----
end_points = EndPoints(Curve=curve)  # -> Start, End
unit_y_2 = UnitY(Factor=1)
vector_2pt_2 = Vector2Pt(PointA=end_points.Start, PointB=end_points.End, Unitize=False)  # -> Vector, Length
xy_plane_2 = XYPlane(Origin=Point(0, 0, 0))
angle_2 = Angle(VectorA=unit_y_2, VectorB=vector_2pt_2.Vector, Plane=xy_plane_2)  # -> Angle, Reflex

# ---- group: window params
list_item_2 = ListItem(List=tree_branch, Index=0, Wrap=True)  # -> Item, Item1, Item2

# ----
degrees_2 = Degrees(Radians=angle_2.Angle)
subtraction = Subtraction(A=degrees_2, B="180")

# ---- group: cull 0s and duplicates
equality = Equality(FirstNumber=relay, SecondNumber="0")  # -> Equality, Inequality
cull_pattern = CullPattern(List=relay, CullPattern=equality.Inequality)
create_set = CreateSet(List=cull_pattern)  # -> Set, Map

# ---- group: north symbol
panel_5 = Panel("0,0,0")
division = Division(A=arrow_thickness, B="2")
xy_plane_3 = XYPlane(Origin=panel_5)
subtraction_2 = Subtraction(A="0", B=division)
circle = Circle(Plane=xy_plane_3, Radius=sign_size)
line_sdl = LineSDL(Start=panel_5, Direction=point, Length=sign_size)
offset_curve = OffsetCurve(Curve=line_sdl, Distance=[division, subtraction_2], Corners=1)  # -> flatten(Curve)
loft = Loft(Curves=offset_curve, Options={Adjust=False, Closed=False, LoftEnds=0, LoftSimp=0, LoftType=0, Rebuild=10, Refit=0.01})

# ----
curve_10 = Curve()  # disabled
curve_11 = Curve(curve_10)  # disabled
curve_12 = Curve(list_item)

vector = Vector(end_points.Start)

# ---- group: desks
unit_z = UnitZ(Factor=1)
move = Move(Geometry=curve_4, Motion=unit_z)  # -> Geometry, Transform
box_rectangle = BoxRectangle(Rectangle=curve_4, Height=desk_height)
boundary_surfaces = BoundarySurfaces(Edges=move.Geometry)

# ----
unit_z_2 = UnitZ(Factor=Slider(1, range=0..1))  # -> expr("-x", UnitVector)
move_2 = Move(Geometry=box_rectangle, Motion=unit_z_2)  # -> Geometry, Transform

# ---- group: base curve with vectors
explode = Explode(Curve=curve_12, Recursive=True)  # -> Segments, Vertices
shift_list = ShiftList(List=explode.Vertices, Shift="1", Wrap=True)
vector_2pt_3 = Vector2Pt(PointA=explode.Vertices, PointB=shift_list, Unitize=False)  # -> Vector, Length

# ---- group: remove leftover lines / base points
divide_distance = DivideDistance(Curve=explode.Segments, Distance=list_item_2.Item1)  # -> flatten(Points), Tangents, Parameters

# ---- group: remove leftover lines
shift_list_2 = ShiftList(List=divide_distance.Points, Shift="1", Wrap=True)
line = Line(StartPoint=divide_distance.Points, EndPoint=shift_list_2)
length = Length(Curve=line)
subtraction_3 = Subtraction(A=list_item_2.Item1, B=".001")
larger_than = LargerThan(FirstNumber=length, SecondNumber=subtraction_3)  # -> LargerThan, OrEqualTo
smaller_than = SmallerThan(FirstNumber=length, SecondNumber=subtraction_3)  # -> SmallerThan, OrEqualTo
cull_pattern_2 = CullPattern(List=line, CullPattern=smaller_than.OrEqualTo)
cull_pattern_3 = CullPattern(List=line, CullPattern=larger_than.LargerThan)
length_2 = Length(Curve=cull_pattern_2)
division_2 = Division(A=length_2, B="2")
amplitude = Amplitude(Vector=vector_2pt_3.Vector, Amplitude=division_2)
cull_index = CullIndex(List=amplitude, Indices="-1", Wrap=True)

# ---- group: N letter
xy_plane_4 = XYPlane(Origin=panel_5)
text_outlines = TextOutlines(TextContent="N", Plane=xy_plane_4, Face="Arial", Size=font_size, Bold=False, Italics=False)  # -> TextCurves, TextBoundingBox
xy_plane_5 = XYPlane(Origin=Point(0, 0, 0))
multiplication = Multiplication(A=font_size, B=".14")
rotate = Rotate(Geometry=text_outlines.TextCurves, Angle=angle.Angle, Plane=xy_plane_5)  # -> Geometry, Transform
addition = Addition(A=multiplication, B=sign_size)
vector_2pt_4 = Vector2Pt(PointA="0,0,0", PointB=point, Unitize=False)  # -> Vector, Length
unit_z_3 = UnitZ(Factor=1)
amplitude_2 = Amplitude(Vector=vector_2pt_4.Vector, Amplitude=addition)
panel_6 = Panel(".045")
rotate_2 = Rotate(Vector=vector_2pt_4.Vector, Axis=unit_z_3, Angle=1.570796327)
move_3 = Move(Geometry=rotate.Geometry, Motion=amplitude_2)  # -> Geometry, Transform
multiplication_2 = Multiplication(A=font_size, B=Slider(-0.8, range=-3..3))
amplitude_3 = Amplitude(Vector=rotate_2, Amplitude=multiplication_2)
move_4 = Move(Geometry=move_3.Geometry, Motion=amplitude_3)  # -> Geometry, Transform
boundary_surfaces_2 = BoundarySurfaces(Edges=move_4.Geometry)

# ----
offset_curve_2 = OffsetCurve(Curve=circle, Distance=Slider(0.08, range=0..1), Corners=1)
shift_paths = ShiftPaths(Data=offset_curve_2, Offset=-1)
loft_2 = Loft(
    Curves=[shift_paths, circle],
    Options={Adjust=False, Closed=False, LoftEnds=0, LoftSimp=0, LoftType=0, Rebuild=10, Refit=0.01})
move_5 = Move(Geometry=[boundary_surfaces_2, loft, loft_2], Motion=north_placement)  # -> Geometry, Transform

join_curves = JoinCurves(Curves=curve_5, Preserve=False)

# ---- group: floor
boundary_surfaces_3 = BoundarySurfaces(Edges=curve_12)
floor = Geometry(boundary_surfaces_3)

# ---- group: ceiling
unit_z_4 = UnitZ(Factor=room_height)
move_6 = Move(Geometry=boundary_surfaces_3, Motion=unit_z_4)  # -> Geometry, Transform
ceiling = Geometry(move_6.Geometry)

# ---- group: optional - only active area simulation
region_intersection = RegionIntersection(CurvesA=list_item, CurvesB=curve_8)
unit_z_5 = UnitZ(Factor=room_height)
boundary_surfaces_4 = BoundarySurfaces(Edges=region_intersection)
extrude = Extrude(Base=boundary_surfaces_4, Direction=unit_z_5)
pok = Brep(extrude)

# ----
list_length = ListLength(List=curve)
ghpython_script = GhPythonScript(amt=list_length)  # -> out, names
# ---------- ghpython_script: Python ----------
__author__ = "Szlek"
__version__ = "2022.09.10"

import rhinoscriptsyntax as rs

names = []
for i in range(1, amt+1):
    names.append("surface_" + str(i))
# ---------- end ghpython_script ----------
panel_7 = Panel(ghpython_script.names)

# ---- group: grid dla biurek
brep = Brep(boundary_surfaces)
genpts = LBGeneratePointGrid(geometry=brep, grid_size="1000")  # -> points, vectors, face_areas, graft(mesh); plug-in component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
graft_tree = GraftTree(Tree=brep, IncludeEmptyLists=True, IncludeNullItems=True)
graft_tree_2 = GraftTree(Tree=ghpython_script.names, IncludeEmptyLists=True, IncludeNullItems=True)
sensorgrid = HBSensorGrid(name=graft_tree_2, positions=genpts.points, directions=genpts.vectors, mesh=genpts.mesh, base_geo=graft_tree)  # -> grid; plug-in component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
point_2 = Point(genpts.points)

# ----
panel_8 = Panel("..\files\POL_Katowice.125600_IMGW.epw")
panel_9 = Panel("C:\Users\Szlek\OneDrive\Dokumenty\GitHub\compute.rhino3d.appserver\src\files\POL_Katowice.125600_IMGW.epw")

# ---- group: analysis settings
integer = Integer([0, 0, 0, 0, 0, 0, 0, 1, 1, 1, 1, 1, 1, 1, 1, 1, 0, 0, 0, 0, 0, 0, 0, 0])
constantschedule = HBConstantSchedule(values=integer)  # -> out, schedule, idf_text; plug-in component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
panel_10 = Panel(constantschedule.idf_text)
panel_11 = Panel("-lt 300 -ut 3000")
wea = HBWeaFromEPW(epw_file=panel_9)  # -> wea; plug-in component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

# ---- group: analysis settings / north
panel_12 = Panel(degrees)

# ----
flip = Flip(Surface=floor)  # -> Surface, Result
mesh_brep = MeshBrep(
    Brep=floor,
    Settings={GridMaxCount=0, GridMinCount=16, JaggedSeams=False, MaxEdgeLength=0, MinEdgeLength=0.0001, MinTolerance=0, Refine=True, RefineAngle=0, RelativeTolerance=0.65, SimplePlanes=True, Tolerance=0})

# ---- group: RH_OUT:floor
mesh = Mesh(flatten(mesh_brep))

# ---- group: room - lux
gradient = Gradient(
    LowerLimit=0,
    UpperLimit=1,
    stops=[0: RGB(234, 38, 0), 0.25: RGB(234, 126, 0), 0.5: RGB(254, 244, 84), 0.75: RGB(173, 203, 249), 1: RGB(75, 107, 169)])  # disabled
gradient_2 = Gradient(LowerLimit=0, UpperLimit=1, stops=[0: RGB(0, 128, 0), 0.5: RGB(255, 255, 0), 1: RGB(255, 0, 0)])  # disabled
merge_4 = Merge(
    Data1=ColourSwatch(SwatchColor=RGB(234, 38, 0)),
    Data2=ColourSwatch(SwatchColor=RGB(202, 219, 74)),
    Data3=ColourSwatch(SwatchColor=RGB(98, 202, 74)),
    Data4=ColourSwatch(SwatchColor=RGB(98, 202, 74)),
    Data5=ColourSwatch(SwatchColor=RGB(149, 202, 78)),
    Data6=ColourSwatch(SwatchColor=RGB(149, 202, 78)),
    Data7=ColourSwatch(SwatchColor=RGB(133, 185, 76)),
    Data8=ColourSwatch(SwatchColor=RGB(133, 185, 76)),
    Data9=ColourSwatch(SwatchColor=RGB(98, 168, 74)),
    Data10=ColourSwatch(SwatchColor=RGB(98, 168, 74)))
merge_5 = Merge(
    Data1=ColourSwatch(SwatchColor=RGB(75, 107, 169)),
    Data2=ColourSwatch(SwatchColor=RGB(173, 203, 249)),
    Data3=ColourSwatch(SwatchColor=RGB(254, 244, 84)),
    Data4=ColourSwatch(SwatchColor=RGB(234, 126, 0)),
    Data5=ColourSwatch(SwatchColor=RGB(234, 38, 0)))

# ----
gradient_3 = Gradient(
    LowerLimit=0,
    UpperLimit=1,
    stops=[0: RGB(234, 38, 0), 0.25: RGB(234, 126, 0), 0.5: RGB(254, 244, 84), 0.75: RGB(173, 203, 249), 1: RGB(75, 107, 169)])  # disabled
gradient_4 = Gradient(LowerLimit=0, UpperLimit=1, stops=[0: RGB(0, 128, 0), 0.5: RGB(255, 255, 0), 1: RGB(255, 0, 0)])  # disabled
merge_6 = Merge(
    Data1=ColourSwatch(SwatchColor=RGB(234, 38, 0)),
    Data2=ColourSwatch(SwatchColor=RGB(254, 244, 84)),
    Data3=ColourSwatch(SwatchColor=RGB(98, 168, 74)))
merge_7 = Merge(
    Data1=ColourSwatch(SwatchColor=RGB(234, 38, 0)),
    Data2=ColourSwatch(SwatchColor=RGB(234, 126, 0)),
    Data3=ColourSwatch(SwatchColor=RGB(254, 244, 84)),
    Data4=ColourSwatch(SwatchColor=RGB(173, 203, 249)),
    Data5=ColourSwatch(SwatchColor=RGB(75, 107, 169)))

legendpar = LBLegendParameters(min="86", max="100", seg_count="10", colors=merge_6, num_decimals="0")  # -> leg_par; plug-in component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

# ---- group: room - lux
legendpar_2 = LBLegendParameters(min="0", max="3000", seg_count="10", colors=merge_4, num_decimals="0")  # -> leg_par; plug-in component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

# ---- group: values for tiles
colour_swatch = ColourSwatch(SwatchColor=RGB(255, 255, 255))

# ----
number_slider_2 = Slider(0.65, range=0..1)
unit_z_6 = UnitZ(Factor="-0.01")
number_slider_3 = Slider(0.65, range=0..1)
unit_z_7 = UnitZ(Factor="-0.01")

# ---- group: tops of the desks
deconstruct_brep = DeconstructBrep(Brep=box_rectangle)  # -> Faces, Edges, Vertices
list_item_3 = ListItem(List=deconstruct_brep.Faces, Index=5, Wrap=True)

# ----
surface = Surface(list_item_3)
area = Area(Geometry=surface)  # -> Area, Centroid

# ---- group: tops of the desks
deconstruct_brep_2 = DeconstructBrep(Brep=box_rectangle)  # -> Faces, Edges, Vertices
list_item_4 = ListItem(List=deconstruct_brep_2.Faces, Index=5, Wrap=True)

# ----
surface_2 = Surface(list_item_4)
area_2 = Area(Geometry=surface_2)  # -> Area, Centroid

radius = Slider(0.6, range=0..1)
circle_2 = Circle(Plane=area.Centroid, Radius=radius)

score_board = Panel("""Range
0 - 100 %



x < 95 % --- X
x ≥ 95 % --- V""")

unit_z_8 = UnitZ(Factor=0.1)
move_7 = Move(Geometry=circle_2, Motion=unit_z_8)  # -> Geometry, Transform
surface_3 = Surface(move_7.Geometry)

# ----
# Score board: Range
# 300 - 3000 lux
# 
# Optimum: 500
# 
# 
# 
# 0 - 300 lux --- X
# 300 - 3000 lux --- V
# 3000 lux + --- X
new_desks_tops = Relay()

boolean_toggle = BooleanToggle(True)

# ---- group: RH_IN:bool
# glare
boolean = Boolean()

# ----
# wynik
# lx
north_placement_2 = MDSlider(
    SliderMode=0,
    slider_value=Point(0.7045221612, 0.3438991271, 0.5),
    x_domain=Domain(-5, 5),
    y_domain=Domain(-15, 0),
    z_domain=Domain(0, 1))

# ---- group: bad values
transparency = Slider(0, range=0..1)
colour_swatch_2 = ColourSwatch(SwatchColor=RGB(219, 66, 66))

transparency_2 = Slider(0, range=0..1)
colour_swatch_3 = ColourSwatch(SwatchColor=RGB(219, 66, 66))

# ---- group: good values
colour_swatch_4 = ColourSwatch(SwatchColor=RGB(175, 219, 61))

# ----
max_score_per_desk = Panel("1")
list_length_2 = ListLength(List=box_rectangle)
multiplication_3 = Multiplication(A=list_length_2, B=max_score_per_desk)
max_score = Panel(multiplication_3)

surface_4 = Surface()
text = Text("test text")

# ---- group: RH_OUT:test
text_2 = Text("tekst")

# ----
point_3 = Point(flatten(area.Centroid))
deconstruct = Deconstruct(Point=point_3)  # -> XComponent, YComponent, ZComponent
merge_8 = Merge(Data1=deconstruct.XComponent, Data2=deconstruct.YComponent, Data3=deconstruct.ZComponent)
text_join = TextJoin(Text=merge_8, Join=", ")

# ---- group: RH_OUT:textBasePtString
text_3 = Text(flatten(text_join))

# ---- group: RH_OUT:textBasePtZ
text_4 = Text(flatten(deconstruct.ZComponent))

# ---- group: RH_OUT:North
mesh_2 = Mesh(flatten(move_5.Geometry))

# ---- group: RH_OUT:textBasePtY
text_5 = Text(flatten(deconstruct.YComponent))

# ---- group: RH_OUT:textBasePtX
text_6 = Text(flatten(deconstruct.XComponent))

# ----
deconstruct_2 = Deconstruct(Point=north_placement_2)  # -> XComponent, YComponent, ZComponent
multiplication_4 = Multiplication(A=deconstruct_2.YComponent, B="-1")
construct_point = ConstructPoint(XCoordinate=multiplication_4, YCoordinate=deconstruct_2.XComponent, ZCoordinate=deconstruct_2.ZComponent)

plane_3pt = Plane3Pt(PointA="0,0,0", PointB="0,1,0", PointC="-1,0,0")
move_8 = Move(Geometry=plane_3pt, Motion=construct_point)  # -> Geometry, Transform
move_9 = Move(Geometry=move_8.Geometry, Motion=Vector(0, 0, 10))  # -> Geometry, Transform

size = Slider(0.19, range=0..1)

# ---- group: MANUAL SHIFT
panel_13 = Panel("""0
1
2""")
panel_14 = Panel("0")

# ---- group: desk orientation
mesh_3 = Mesh([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])
yz_plane = YZPlane(Origin=Point(0, 0, 0))
z = Slider(0.83, range=0..1)
y = Slider(0, range=-1..1)
x = Slider(-2.55, range=-3..1)
rotate_3 = Rotate(Geometry=mesh_3, Angle=1.570796327, Plane=yz_plane)  # -> Geometry, Transform
unit_z_9 = UnitZ(Factor=z)
unit_y_3 = UnitY(Factor=y)

# ----
unit_x = UnitX(Factor=x)
addition_2 = Addition(A=unit_z_9, B=unit_y_3, C=unit_x)

# ---- group: desk orientation (continued)
move_10 = Move(Geometry=rotate_3.Geometry, Motion=addition_2)  # -> Geometry, Transform

# ----
move_11 = Move(Geometry=graft(move_10.Geometry), Motion=vector)  # -> Geometry, Transform

xy_plane_6 = XYPlane(Origin=end_points.Start)
rotate_4 = Rotate(Geometry=move_11.Geometry, Angle=degrees(subtraction), Plane=xy_plane_6)  # -> Geometry, Transform
flip_matrix_2 = FlipMatrix(Data=rotate_4.Geometry)

# ---- group: monitor screen
list_item_5 = ListItem(List=flip_matrix_2, Index="6", Wrap=True)

# ---- group: monitor plastic
list_item_6 = ListItem(List=flip_matrix_2, Index="5", Wrap=True)

# ---- group: desk legs
list_item_7 = ListItem(List=flip_matrix_2, Index="1", Wrap=True)

# ---- group: chair fabric
list_item_8 = ListItem(List=flip_matrix_2, Index="3", Wrap=True)

# ---- group: keyboard
list_item_9 = ListItem(List=flip_matrix_2, Index="4", Wrap=True)

# ---- group: chair legs
list_item_10 = ListItem(List=flip_matrix_2, Index="0", Wrap=True)

# ---- group: desktop
list_item_11 = ListItem(List=flip_matrix_2, Index="2", Wrap=True)

# ---- group: RH_OUT:desk_desktop
mesh_4 = Mesh(flatten(list_item_11))

# ---- group: RH_OUT:desk_keyboard
mesh_5 = Mesh(flatten(list_item_9))

# ---- group: RH_OUT:desk_legs_chair
mesh_6 = Mesh(flatten(list_item_10))

# ---- group: RH_OUT:desk_legs_desk
mesh_7 = Mesh(flatten(list_item_7))

# ---- group: RH_OUT:desk_fabric
mesh_8 = Mesh(flatten(list_item_8))

# ---- group: RH_OUT:desk_plastic
mesh_9 = Mesh(flatten(list_item_6))

# ---- group: RH_OUT:desk_screen
mesh_10 = Mesh(flatten(list_item_5))

# ---- group: division + windows
move_12 = Move(Geometry=explode.Segments, Motion=cull_index)  # -> Geometry, Transform
subtraction_4 = Subtraction(A=list_item_2.Item1, B="0.001")
unit_z_10 = UnitZ(Factor=list_item_2.Item)
unit_z_11 = UnitZ(Factor=list_item_2.Item2)

# ---- group: division + windows / centered points
divide_distance_2 = DivideDistance(Curve=move_12.Geometry, Distance=list_item_2.Item1)  # -> flatten(Points), flatten(Tangents), Parameters

# ---- group: division + windows (continued)
polyline = PolyLine(Vertices=divide_distance_2.Points, Closed=True)
explode_2 = Explode(Curve=polyline, Recursive=True)  # -> Segments, Vertices
length_3 = Length(Curve=explode_2.Segments)
larger_than_2 = LargerThan(FirstNumber=length_3, SecondNumber=subtraction_4)  # -> LargerThan, OrEqualTo
cull_pattern_4 = CullPattern(List=explode_2.Segments, CullPattern=larger_than_2.LargerThan)

# ---- group: test if curve is in active_area
end_points_2 = EndPoints(Curve=cull_pattern_4)  # -> Start, End
point_in_curve = PointInCurve(Point=end_points_2.Start, Curve=curve_8)  # -> Relationship, Point
smaller_than_2 = SmallerThan(FirstNumber="0", SecondNumber=point_in_curve.Relationship)  # -> SmallerThan, OrEqualTo
cull_pattern_5 = CullPattern(List=cull_pattern_4, CullPattern=smaller_than_2.SmallerThan)

# ---- group: division + windows (continued)
list_item_12 = ListItem(List=cull_pattern_5, Index=expr("x-1", create_set.Set), Wrap=True)

# ---- group: BREAKS BETWEEN WINDOWS
extend_curve = ExtendCurve(Curve=list_item_12, Type=0, Start="0", End="0")

# ---- group: MANUAL SHIFT (continued)
end_points_3 = EndPoints(Curve=extend_curve)  # -> Start, End
vector_2pt_5 = Vector2Pt(PointA=end_points_3.Start, PointB=end_points_3.End, Unitize=True)  # -> Vector, Length
amplitude_4 = Amplitude(Vector=vector_2pt_5.Vector, Amplitude=Slider(0, range=-2..2))
move_13 = Move(Geometry=extend_curve, Motion=amplitude_4)  # -> Geometry, Transform

# ---- group: division + windows (continued)
move_14 = Move(Geometry=move_13.Geometry, Motion=unit_z_10)  # -> Geometry, Transform
move_15 = Move(Geometry=move_13.Geometry, Motion=unit_z_10)  # -> Geometry, Transform
move_16 = Move(Geometry=move_14.Geometry, Motion=unit_z_11)  # -> Geometry, Transform
explode_3 = Explode(Curve=move_15.Geometry, Recursive=True)  # -> Segments, Vertices
explode_4 = Explode(Curve=move_16.Geometry, Recursive=True)  # -> Segments, Vertices
list_item_13 = ListItem(List=explode_4.Vertices, Index="0", Wrap=True)
list_item_14 = ListItem(List=explode_4.Vertices, Index="1", Wrap=True)
list_item_15 = ListItem(List=explode_3.Vertices, Index="0", Wrap=True)
list_item_16 = ListItem(List=explode_3.Vertices, Index="1", Wrap=True)
rectangle_3pt = Rectangle3Pt(PointA=list_item_15, PointB=list_item_16, PointC=list_item_13)  # -> Rectangle, Length

# ---- group: division + windows / window
_4point_surface = _4PointSurface(CornerA=list_item_15, CornerB=list_item_16, CornerC=list_item_14, CornerD=list_item_13)  # -> flatten(Surface)

# ---- group: division + windows (continued)
face_normals = FaceNormals(Mesh=_4point_surface)  # -> Centers, Normals
box_rectangle_2 = BoxRectangle(Rectangle=_4point_surface, Height=wall_thickness)
amplitude_5 = Amplitude(Vector=face_normals.Normals, Amplitude=wall_thickness)

# ---- group: division + windows / window cap
extrude_2 = Extrude(Base=rectangle_3pt.Rectangle, Direction=amplitude_5)
window_cap = Geometry(flatten(extrude_2))

# ----
amplitude_6 = Amplitude(Vector=face_normals.Normals, Amplitude="0.02")
amplitude_7 = Amplitude(Vector=face_normals.Normals, Amplitude="0.02")
mesh_to_polysurface = MeshToPolysurface(Mesh=window_cap, Triangles=False, FaceMerge=False)
deconstruct_brep_3 = DeconstructBrep(Brep=mesh_to_polysurface)  # -> Faces, Edges, Vertices
flip_2 = Flip(Surface=deconstruct_brep_3.Faces)  # -> Surface, Result
mesh_brep_2 = MeshBrep(
    Brep=flip_2.Surface,
    Settings={GridMaxCount=0, GridMinCount=16, JaggedSeams=False, MaxEdgeLength=0, MinEdgeLength=0.0001, MinTolerance=0, Refine=True, RefineAngle=0, RelativeTolerance=0.65, SimplePlanes=True, Tolerance=0})

# ---- group: RH_OUT:window_wall
mesh_11 = Mesh(flatten(mesh_brep_2))

# ---- group: wall active area split
trim_with_region = TrimWithRegion(Curve=list_item, Region=curve_8)  # -> Inside, Outside

# ---- group: interior walls
division_3 = Division(A=int_wall_width, B="2")
multiplication_5 = Multiplication(A=division_3, B="-1")
offset_curve_3 = OffsetCurve(Curve=join_curves, Distance=division_3, Corners=1)
offset_curve_4 = OffsetCurve(Curve=join_curves, Distance=multiplication_5, Corners=1)
end_points_4 = EndPoints(Curve=offset_curve_4)  # -> Start, End
end_points_5 = EndPoints(Curve=offset_curve_3)  # -> Start, End
line_2 = Line(StartPoint=end_points_5.Start, EndPoint=end_points_4.Start)
line_3 = Line(StartPoint=end_points_5.End, EndPoint=end_points_4.End)
join_curves_2 = JoinCurves(Curves=[offset_curve_3, line_2, offset_curve_4, line_3], Preserve=False)

# ---- group: bypass active area if intersection is null
null_item = NullItem(Item=trim_with_region.Inside)  # -> NullFlags, InvalidFlags, Description
stream_filter = StreamFilter(Gate=null_item.NullFlags, Stream0=trim_with_region.Inside, Stream1=list_item)

# ---- group: main geo
offset_curve_5 = OffsetCurve(Curve=curve_12, Distance=wall_thickness, Corners=1)
unit_z_12 = UnitZ(Factor=room_height)

# ---- group: wall active area split (continued)
trim_with_region_2 = TrimWithRegion(Curve=offset_curve_5, Region=curve_8)  # -> Inside, Outside

# ---- group: bypass active area if intersection is null (continued)
null_item_2 = NullItem(Item=trim_with_region_2.Inside)  # -> NullFlags, InvalidFlags, Description
stream_filter_2 = StreamFilter(Gate=null_item_2.NullFlags, Stream0=trim_with_region_2.Inside, Stream1=offset_curve_5)

# ---- group: cap walls - active area intersection
trim_with_region_3 = TrimWithRegion(Curve=curve_8, Region=offset_curve_5)  # -> Inside, Outside
trim_with_region_4 = TrimWithRegion(Curve=trim_with_region_3.Inside, Region=list_item)  # -> Inside, Outside
extrude_3 = Extrude(Base=trim_with_region_4.Outside, Direction=unit_z_12)

# ---- group: inactive wall cap bot
region_difference = RegionDifference(CurvesA=offset_curve_5, CurvesB=curve_8)
region_difference_2 = RegionDifference(CurvesA=region_difference, CurvesB=curve_12)
boundary_surfaces_5 = BoundarySurfaces(Edges=region_difference_2)

# ---- group: interior walls (continued)
extrude_4 = Extrude(Base=join_curves_2, Direction=unit_z_12)
cap_holes = CapHoles(Brep=extrude_4)  # -> flatten(Brep)
solid_union = SolidUnion(Breps=cap_holes)

# ---- group: main geo / inactive cap wall top
move_17 = Move(Geometry=boundary_surfaces_5, Motion=unit_z_12)  # -> Geometry, Transform

# ---- group: main geo / wall inactive out
extrude_5 = Extrude(Base=trim_with_region_2.Outside, Direction=unit_z_12)

# ---- group: main geo / wall active out
extrude_6 = Extrude(Base=stream_filter_2, Direction=unit_z_12)

# ---- group: main geo / wall inactive in
extrude_7 = Extrude(Base=trim_with_region.Outside, Direction=unit_z_12)

# ---- group: main geo / wall active in
extrude_8 = Extrude(Base=stream_filter, Direction=unit_z_12)

# ---- group: window cut in
trim_solid = TrimSolid(Shape=extrude_6, Cutters=flatten(box_rectangle_2))

# ---- group: window cut out
trim_solid_2 = TrimSolid(Shape=extrude_8, Cutters=flatten(box_rectangle_2))

# ---- group: main geo (continued)
walls = Geometry(flatten([boundary_surfaces_5, extrude_5, extrude_7, move_17.Geometry]))

# ---- group: walls
inactive_walls = Relay([walls, extrude_3])
active_walls = Relay([trim_solid, trim_solid_2])

# ----
extrude_9 = Extrude(Base=floor, Direction=unit_z_12)
pok_2 = Brep(extrude_9)

pok_3 = Brep([pok, pok_2])
geometry = Geometry(extrude_5)
geometry_2 = Geometry(trim_solid)
geometry_3 = Geometry(trim_solid_2)
deconstruct_brep_4 = DeconstructBrep(Brep=geometry)  # -> Faces, Edges, Vertices
deconstruct_brep_5 = DeconstructBrep(Brep=geometry_2)  # -> Faces, Edges, Vertices
merge_9 = Merge(Data1=stream_filter_2, Data2=stream_filter)  # -> flatten(Result)
geometry_4 = Geometry(move_17.Geometry)
deconstruct_brep_6 = DeconstructBrep(Brep=geometry_3)  # -> Faces, Edges, Vertices
geometry_5 = Geometry(extrude_7)
mesh_to_polysurface_2 = MeshToPolysurface(Mesh=geometry_5, Triangles=False, FaceMerge=False)
flip_3 = Flip(Surface=deconstruct_brep_5.Faces)  # -> Surface, Result
loft_3 = Loft(Curves=merge_9, Options={Adjust=False, Closed=False, LoftEnds=0, LoftSimp=0, LoftType=0, Rebuild=10, Refit=0.01})
deconstruct_brep_7 = DeconstructBrep(Brep=mesh_to_polysurface_2)  # -> Faces, Edges, Vertices
flip_4 = Flip(Surface=deconstruct_brep_6.Faces)  # -> Surface, Result
flip_5 = Flip(Surface=deconstruct_brep_4.Faces)  # -> Surface, Result
flip_6 = Flip(Surface=deconstruct_brep_7.Faces)  # -> Surface, Result
move_18 = Move(Geometry=loft_3, Motion=unit_z_12)  # -> Geometry, Transform
deconstruct_brep_8 = DeconstructBrep(Brep=[geometry_2, deconstruct_brep_4.Faces])  # -> Faces, Edges, Vertices
mesh_brep_3 = MeshBrep(
    Brep=[move_18.Geometry, geometry_3],
    Settings={GridMaxCount=0, GridMinCount=16, JaggedSeams=False, MaxEdgeLength=0, MinEdgeLength=0.0001, MinTolerance=0, Refine=True, RefineAngle=0, RelativeTolerance=0.65, SimplePlanes=True, Tolerance=0})
mesh_brep_4 = MeshBrep(
    Brep=[geometry_5, geometry_4],
    Settings={GridMaxCount=0, GridMinCount=16, JaggedSeams=False, MaxEdgeLength=0, MinEdgeLength=0.0001, MinTolerance=0, Refine=True, RefineAngle=0, RelativeTolerance=0.65, SimplePlanes=True, Tolerance=0})
pipe = Pipe(Curve=deconstruct_brep_8.Edges, Radius=Slider(0.01, range=0.005..1), Caps=0)

# ---- group: RH_OUT:walls_ext_inactive
mesh_12 = Mesh(flatten(mesh_brep_4))

# ---- group: RH_OUT:walls_ext_active
mesh_13 = Mesh(flatten(mesh_brep_3))

# ---- group: RH_OUT:walls_lines
mesh_14 = Mesh(flatten(pipe))

# ---- group: RH_OUT:walls_bottom
mesh_15 = Mesh(flatten([loft_3, boundary_surfaces_5]))

# ----
mesh_to_polysurface_3 = MeshToPolysurface(Mesh=[mesh_brep_3, mesh_brep_4, mesh_brep_2, mesh_brep], Triangles=False, FaceMerge=False)
deconstruct_brep_9 = DeconstructBrep(Brep=mesh_to_polysurface_3)  # -> Faces, Edges, Vertices
flip_7 = Flip(Surface=deconstruct_brep_9.Faces)  # -> Surface, Result
normal_display = NormalDisplay(Geometry=flip_7.Surface, FrontFaceColor=RGB(128, 128, 128), BackFaceColor=RGB(255, 0, 0))

# ---- group: window frame
rectangle_3pt_2 = Rectangle3Pt(PointA=list_item_15, PointB=list_item_16, PointC=list_item_13)  # -> Rectangle, Length
amplitude_8 = Amplitude(Vector=face_normals.Normals, Amplitude=frame_depth)
offset_curve_6 = OffsetCurve(Curve=rectangle_3pt_2.Rectangle, Distance=expr("-x", frame_width), Corners=1)
move_19 = Move(Geometry=rectangle_3pt_2.Rectangle, Motion=amplitude_8)  # -> Geometry, Transform

# ---- group: window glass
amplitude_9 = Amplitude(Vector=face_normals.Normals, Amplitude=frame_depth)
move_20 = Move(Geometry=offset_curve_6, Motion=amplitude_9)  # -> Geometry, Transform
boundary_surfaces_6 = BoundarySurfaces(Edges=move_20.Geometry)

# ---- group: window frame (continued)
boundary_surfaces_7 = BoundarySurfaces(Edges=flatten([move_19.Geometry, move_20.Geometry]))

# ---- group: windows
amplitude_10 = Amplitude(Vector=face_normals.Normals, Amplitude=frame_depth)
move_21 = Move(Geometry=boundary_surfaces_6, Motion=expr("-x", amplitude_10))  # -> Geometry, Transform

brep_2 = Brep(move_21.Geometry)

# ----
geometry_6 = Geometry(boundary_surfaces_7)
flip_8 = Flip(Surface=boundary_surfaces_6)  # -> Surface, Result
move_22 = Move(Geometry=graft(geometry_6), Motion=amplitude_6)  # -> Geometry, Transform
move_23 = Move(Geometry=boundary_surfaces_6, Motion=amplitude_7)  # -> Geometry, Transform
flip_9 = Flip(Surface=geometry_6)  # -> Surface, Result
mesh_brep_5 = MeshBrep(
    Brep=[flip_8.Surface, move_23.Geometry],
    Settings={GridMaxCount=0, GridMinCount=16, JaggedSeams=False, MaxEdgeLength=0, MinEdgeLength=0.0001, MinTolerance=0, Refine=True, RefineAngle=0, RelativeTolerance=0.65, SimplePlanes=True, Tolerance=0})
mesh_brep_6 = MeshBrep(
    Brep=[flip_9.Surface, move_22.Geometry],
    Settings={GridMaxCount=0, GridMinCount=16, JaggedSeams=False, MaxEdgeLength=0, MinEdgeLength=0.0001, MinTolerance=0, Refine=True, RefineAngle=0, RelativeTolerance=0.65, SimplePlanes=True, Tolerance=0})

# ---- group: RH_OUT:window_glass
mesh_16 = Mesh(flatten(mesh_brep_5))

# ---- group: RH_OUT:window_frame
mesh_17 = Mesh(flatten(mesh_brep_6))

# ---- group: rooms
columns = Relay()
cabinets = Relay()  # disabled
solid_difference = SolidDifference(BrepsA=pok_3, BrepsB=[columns, cabinets, solid_union])

# ----
mesh_volume = MeshVolume(Mesh=solid_difference)  # -> Volume, Centroid
sort_list = SortList(Keys=mesh_volume.Volume, ValuesValuesA=solid_difference)  # -> Keys, ValuesValuesA
reverse_list = ReverseList(List=sort_list.ValuesValuesA)
list_item_17 = ListItem(List=reverse_list, Index=0, Wrap=True)
null_item_3 = NullItem(Item=list_item_17)  # -> NullFlags, InvalidFlags, Description
stream_filter_3 = StreamFilter(Gate=null_item_3.NullFlags, Stream0=list_item_17, Stream1=pok_3)

# ---- group: rooms (continued)
geometry_7 = Geometry(stream_filter_3)
roomsolid = HBRoomFromSolid(geo=flatten(geometry_7), name="office_1", conditioned=Toggle(True))  # -> report, rooms; plug-in component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

# ---- group: windows
glassmod = HBGlassModifier(name="glass_material", trans="0.6")  # -> modifier; plug-in component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
aperture = HBAperture(geo=brep_2, operable=Toggle(True), rad_mod=glassmod)  # -> report, apertures; plug-in component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
addsubface = HBAddSubface(hb_obj=flatten(roomsolid.rooms), sub_faces=flatten(aperture.apertures))  # -> hb_obj; plug-in component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
multiplication_6 = Multiplication(B="0.01")
bordershades = HBExtrudedBorderShades(hb_objs=flatten(addsubface), depth=multiplication_6)  # -> report, hb_objs; plug-in component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

# ---- group: model
relay_2 = Relay()
model = HBModel(rooms=flatten(bordershades.hb_objs), name="hb_grid")  # -> out, model; plug-in component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
assigngridsviews = HBAssignGridsAndViews(model=model.model, grids=flatten(sensorgrid))  # -> model; plug-in component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

# ---- group: grid dla pokoju
panel_15 = Panel("0.8")
gridrooms = HBSensorGridFromRooms(rooms=bordershades.hb_objs, grid_size="0.3", dist_floor=panel_15)  # -> grid, points, graft(mesh); plug-in component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
assigngridsviews_2 = HBAssignGridsAndViews(model=model.model, grids=flatten(gridrooms.grid))  # -> model; plug-in component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
mesh_join = MeshJoin(Meshes=flatten(gridrooms.mesh))

# ---- group: room - glare
annualglare = HBImagelessAnnualGlare(model=assigngridsviews_2, wea=wea, north=degrees, glare_thresh="0.45", schedule=constantschedule.schedule, run=boolean)  # -> out, results, GA; plug-in component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
avgvalues = HBAnnualAverageValues(results=annualglare.results)  # -> out, values; disabled; plug-in component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
panel_16 = Panel(avgvalues.values)  # disabled

# ---- group: room - lux / calculating room
annualdaylight = HBAnnualDaylight(model=assigngridsviews_2, wea=wea, north=degrees, thresholds=panel_11, schedule=constantschedule.schedule, run=boolean)  # -> out, results, DA, cDA, UDI, UDI_low, UDI_up; plug-in component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

# ---- group: room - lux
avgvalues_2 = HBAnnualAverageValues(results=annualdaylight.results)  # -> out, values; disabled; plug-in component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
avgvalues_3 = HBAnnualAverageValues(results=annualdaylight.results)  # -> out, values; plug-in component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
average_values = Panel(avgvalues_3.values)
round_to_decimal_place = RoundToDecimalPlace(NumberX=average_values, DecimalPlace=2, RoundType=0)  # -> Rounded, Difference

# ----
godzin_bez_glare = Panel(annualglare.GA)
round_to_decimal_place_2 = RoundToDecimalPlace(NumberX=godzin_bez_glare, DecimalPlace=1, RoundType=0)  # -> Rounded, Difference

sort_list_2 = SortList(Keys=godzin_bez_glare)  # -> Keys, ValuesValuesA
list_item_18 = ListItem(List=sort_list_2.Keys, Index=0, Wrap=True)  # -> Item1, Item
najwieksza_wartosc = Panel(list_item_18.Item1)
najmniejsza_wartosc = Panel(list_item_18.Item)

# ---- group: bypass errors - if there are no calculated values, pass nothing
list_length_3 = ListLength(List=round_to_decimal_place_2.Rounded)
smaller_than_3 = SmallerThan(FirstNumber=list_length_3, SecondNumber="2")  # -> SmallerThan, OrEqualTo
stream_filter_4 = StreamFilter(Gate=smaller_than_3.SmallerThan, Stream0=round_to_decimal_place_2.Rounded)

# ---- group: room - lux
panel_17 = Panel(round_to_decimal_place.Rounded)
sort_list_3 = SortList(Keys=panel_17)  # -> Keys, ValuesValuesA
list_item_19 = ListItem(List=sort_list_3.Keys, Index=0, Wrap=True)  # -> Item1, Item
biggest_value = Panel(list_item_19.Item1)
smallest_value = Panel(list_item_19.Item)

# ---- group: room - lux / bypass errors - if there are no calculated values, pass 0s / bypass errors - if there are no calculated values, pass nothing
list_length_4 = ListLength(List=round_to_decimal_place.Rounded)
smaller_than_4 = SmallerThan(FirstNumber=list_length_4, SecondNumber="2")  # -> SmallerThan, OrEqualTo
stream_filter_5 = StreamFilter(Gate=smaller_than_4.SmallerThan, Stream0=round_to_decimal_place.Rounded)

# ----
heatmap = LBSpatialHeatmap(values=flatten(stream_filter_4), mesh=mesh_join, legend_par=legendpar, legend_title="% godzin bez \"glare\"")  # -> mesh, legend, title, colors, legend_par; plug-in component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

# ---- group: room - lux
heatmap_2 = LBSpatialHeatmap(values=flatten(stream_filter_5), mesh=mesh_join, legend_par=legendpar_2, legend_title="średnie natężenie (lx)")  # -> mesh, legend, title, colors, legend_par; plug-in component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

# ---- group: alternative grid
smaller_than_5 = SmallerThan(FirstNumber=average_values, SecondNumber="3000")  # -> SmallerThan, OrEqualTo
larger_than_3 = LargerThan(FirstNumber=average_values, SecondNumber="300")  # -> LargerThan, OrEqualTo
panel_18 = Panel(smaller_than_5.SmallerThan)
panel_19 = Panel(larger_than_3.LargerThan)
gate_and = GateAnd(A=panel_19, B=panel_18)
mesh_explode = MeshExplode(Mesh=heatmap_2.mesh, Interpolate=False)
panel_20 = Panel(gate_and)
mesh_18 = Mesh(mesh_explode)
dispatch = Dispatch(List=mesh_18, DispatchPattern=panel_20)  # -> ListA, ListB
mesh_19 = Mesh(dispatch.ListA)
mesh_20 = Mesh(dispatch.ListB)
mesh_colours = MeshColours(Mesh=mesh_20, Colours=ColourSwatch(SwatchColor=RGB(219, 66, 66)))
mesh_colours_2 = MeshColours(Mesh=mesh_19, Colours=ColourSwatch(SwatchColor=RGB(175, 219, 61)))

# ----
mesh_explode_2 = MeshExplode(Mesh=heatmap.mesh, Interpolate=False)

# ---- group: legend
unit_z_13 = UnitZ(Factor=panel_15)  # -> expr("-x", UnitVector)
move_24 = Move(Geometry=heatmap.legend, Motion=unit_z_13)  # -> Geometry, Transform
unit_x_2 = UnitX(Factor=4)
move_25 = Move(Geometry=move_24.Geometry, Motion=unit_x_2)  # -> Geometry, Transform

# ---- group: calculating illuminance for desks from closest grid pts
area_3 = Area(Geometry=brep)  # -> Area, Centroid
closest_point = ClosestPoint(Point=area_3.Centroid, Cloud=flatten(gridrooms.points))  # -> ClosestPoint, CPIndex, Distance
list_item_20 = ListItem(List=round_to_decimal_place_2.Rounded, Index=closest_point.CPIndex, Wrap=True)
value_of_the_closest_point = Panel(list_item_20)

# ----
mesh_21 = Mesh(mesh_explode_2)

# ---- group: bypass errors - pass empty parameter instead of null
null_item_4 = NullItem(Item=mesh_21)  # -> NullFlags, InvalidFlags, Description; disabled
stream_filter_6 = StreamFilter(Gate=null_item_4.NullFlags, Stream0=mesh_21)  # disabled

# ---- group: calculating illuminance for desks from closest grid pts
area_4 = Area(Geometry=brep)  # -> Area, Centroid
closest_point_2 = ClosestPoint(Point=area_4.Centroid, Cloud=flatten(gridrooms.points))  # -> ClosestPoint, CPIndex, Distance
list_item_21 = ListItem(List=round_to_decimal_place.Rounded, Index=closest_point_2.CPIndex, Wrap=True)
value_of_the_closest_point_2 = Panel(list_item_21)

# ----
mesh_explode_3 = MeshExplode(Mesh=heatmap_2.mesh, Interpolate=False)

# ---- group: legend
unit_z_14 = UnitZ(Factor=panel_15)  # -> expr("-x", UnitVector)
move_26 = Move(Geometry=heatmap_2.legend, Motion=unit_z_14)  # -> Geometry, Transform
unit_x_3 = UnitX(Factor=4)
move_27 = Move(Geometry=move_26.Geometry, Motion=unit_x_3)  # -> Geometry, Transform

# ----
stream_filter_7 = StreamFilter(Gate=boolean, Stream1=mesh_21)
area_5 = Area(Geometry=mesh_explode_3)  # -> Area, Centroid
mesh_22 = Mesh(mesh_explode_3)
deconstruct_mesh = DeconstructMesh(Mesh=flatten(stream_filter_7))  # -> Vertices, Faces, Colours, Normals

# ---- group: bypass errors - pass empty parameter instead of null
list_item_22 = ListItem(List=mesh_22, Index=0, Wrap=True)
null_item_5 = NullItem(Item=list_item_22)  # -> NullFlags, InvalidFlags, Description
stream_filter_8 = StreamFilter(Gate=null_item_5.NullFlags, Stream0=mesh_22)

# ----
construct_mesh = ConstructMesh(Vertices=deconstruct_mesh.Vertices, Faces=deconstruct_mesh.Faces, Colours=deconstruct_mesh.Colours)
deconstruct_mesh_2 = DeconstructMesh(Mesh=flatten(stream_filter_8))  # -> Vertices, Faces, Colours, Normals
construct_mesh_2 = ConstructMesh(Vertices=deconstruct_mesh_2.Vertices, Faces=deconstruct_mesh_2.Faces, Colours=deconstruct_mesh_2.Colours)
list_item_23 = ListItem(List=construct_mesh, Index=0, Wrap=True)  # -> flatten(Item)
list_item_24 = ListItem(List=construct_mesh_2, Index=0, Wrap=True)  # -> flatten(Item)
move_28 = Move(Geometry=list_item_23, Motion=unit_z_6)  # -> Geometry, Transform
move_29 = Move(Geometry=list_item_24, Motion=unit_z_7)  # -> Geometry, Transform

# ---- group: bypass errors
list_item_25 = ListItem(List=flatten(mesh_colours_2), Index=0, Wrap=True)
null_item_6 = NullItem(Item=list_item_25)  # -> NullFlags, InvalidFlags, Description
stream_filter_9 = StreamFilter(Gate=null_item_6.NullFlags, Stream0=mesh_colours_2)

list_item_26 = ListItem(List=flatten(mesh_colours), Index=0, Wrap=True)
null_item_7 = NullItem(Item=list_item_26)  # -> NullFlags, InvalidFlags, Description
stream_filter_10 = StreamFilter(Gate=null_item_7.NullFlags, Stream0=mesh_colours)

# ----
data = Data(graft(value_of_the_closest_point))
panel_21 = Panel(data)
flatten_tree = FlattenTree(Tree=panel_21, Path="{0}")  # -> graft(Tree)
panel_22 = Panel(flatten_tree)

data_2 = Data(graft(list_item_21))
panel_23 = Panel(data_2)
flatten_tree_2 = FlattenTree(Tree=panel_23, Path="{0}")  # -> graft(Tree)
panel_24 = Panel(flatten_tree_2)

# ---- group: mesh - grid
deconstruct_mesh_3 = DeconstructMesh(Mesh=stream_filter_9)  # -> Vertices, Faces, Colours, Normals
construct_mesh_3 = ConstructMesh(Vertices=deconstruct_mesh_3.Vertices, Faces=deconstruct_mesh_3.Faces)
unit_z_15 = UnitZ(Factor=0)
move_30 = Move(Geometry=construct_mesh_3, Motion=unit_z_15)  # -> Geometry, Transform

deconstruct_mesh_4 = DeconstructMesh(Mesh=stream_filter_10)  # -> Vertices, Faces, Colours, Normals
construct_mesh_4 = ConstructMesh(Vertices=deconstruct_mesh_4.Vertices, Faces=deconstruct_mesh_4.Faces)
unit_z_16 = UnitZ(Factor=0)
move_31 = Move(Geometry=construct_mesh_4, Motion=unit_z_16)  # -> Geometry, Transform

# ----
data_3 = Data(panel_24)

round_to_decimal_place_3 = RoundToDecimalPlace(NumberX=panel_22, DecimalPlace=1, RoundType=0)  # -> Rounded, Difference
text_7 = Panel("%")  # disabled
text_8 = Text(round_to_decimal_place_3.Rounded)
text_9 = Text(text_7)
replace_items = ReplaceItems(List=text_8, Item=text_9, Indices=0, Wrap=False)
flatten_tree_3 = FlattenTree(Tree=replace_items, Path="{0}")  # -> graft(Tree)
text_join_2 = TextJoin(Text=[text_8, flatten_tree_3])

round_to_decimal_place_4 = RoundToDecimalPlace(NumberX=data_3, DecimalPlace=0, RoundType=0)  # -> Rounded, Difference
text_10 = Panel(" lx")  # disabled
text_11 = Text(round_to_decimal_place_4.Rounded)
text_12 = Text(text_10)
replace_items_2 = ReplaceItems(List=text_11, Item=text_12, Indices=0, Wrap=False)
flatten_tree_4 = FlattenTree(Tree=replace_items_2, Path="{0}")  # -> graft(Tree)
text_join_3 = TextJoin(Text=[text_11, flatten_tree_4])

text_outlines_2 = TextOutlines(TextContent=text_join_2, Plane=PlaneXY(0, 0, 0), Face="Arial", Size=Slider(0.32, range=0..1), Bold=False, Italics=False)  # -> TextCurves, TextBoundingBox
boundary_surfaces_8 = BoundarySurfaces(Edges=text_outlines_2.TextCurves)
surface_5 = Surface(boundary_surfaces_8)
bounding_box = BoundingBox(Content=surface_5, Plane=PlaneXY(0, 0, 0), UnionBox=True)  # -> Box, Box_2
area_6 = Area(Geometry=bounding_box.Box)  # -> Area, Centroid
orient = Orient(Geometry=surface_5, Source=area_6.Centroid, Target=area.Centroid)  # -> Geometry, Transform
unit_z_17 = UnitZ(Factor=0.12)
move_32 = Move(Geometry=orient.Geometry, Motion=unit_z_17)  # -> Geometry, Transform
bounding_box_2 = BoundingBox(Content=move_32.Geometry, Plane=PlaneXY(0, 0, 0), UnionBox=True)  # -> Box, Box_2
area_7 = Area(Geometry=bounding_box_2.Box)  # -> Area, Centroid

text_outlines_3 = TextOutlines(TextContent=text_join_3, Plane=PlaneXY(0, 0, 0), Face="Arial", Size=Slider(0.32, range=0..1), Bold=False, Italics=False)  # -> TextCurves, TextBoundingBox
boundary_surfaces_9 = BoundarySurfaces(Edges=text_outlines_3.TextCurves)
surface_6 = Surface(boundary_surfaces_9)
bounding_box_3 = BoundingBox(Content=surface_6, Plane=PlaneXY(0, 0, 0), UnionBox=True)  # -> Box, Box_2
area_8 = Area(Geometry=bounding_box_3.Box)  # -> Area, Centroid
orient_2 = Orient(Geometry=surface_6, Source=area_8.Centroid, Target=area_2.Centroid)  # -> Geometry, Transform
unit_z_18 = UnitZ(Factor=0.12)
move_33 = Move(Geometry=orient_2.Geometry, Motion=unit_z_18)  # -> Geometry, Transform
bounding_box_4 = BoundingBox(Content=move_33.Geometry, Plane=PlaneXY(0, 0, 0), UnionBox=True)  # -> Box, Box_2
area_9 = Area(Geometry=bounding_box_4.Box)  # -> Area, Centroid

panel_25 = Panel(flatten_tree)
division_4 = Division(A="360", B="100")
multiplication_7 = Multiplication(A=division_4, B=panel_25)
panel_26 = Panel(multiplication_7)

area_10 = Area(Geometry=move_7.Geometry)  # -> Area, Centroid
unit_y_4 = UnitY(Factor=1)
line_sdl_2 = LineSDL(Start=area_10.Centroid, Direction=unit_y_4, Length=radius)
rotate_5 = Rotate(Geometry=line_sdl_2, Angle=degrees(panel_26), Plane=area_10.Centroid)  # -> Geometry, Transform
join_curves_3 = JoinCurves(Curves=[line_sdl_2, rotate_5.Geometry], Preserve=False)

smaller_than_6 = SmallerThan(FirstNumber=data_3, SecondNumber="3000")  # -> SmallerThan, OrEqualTo
larger_than_4 = LargerThan(FirstNumber=data_3, SecondNumber="300")  # -> LargerThan, OrEqualTo
panel_27 = Panel(smaller_than_6.SmallerThan)
panel_28 = Panel(larger_than_4.LargerThan)
gate_and_2 = GateAnd(A=panel_28, B=panel_27)
panel_29 = Panel(gate_and_2)
box = Box(graft(list_item_4))  # disabled
dispatch_2 = Dispatch(List=new_desks_tops, DispatchPattern=panel_29)  # -> ListA, ListB
brep_3 = Brep(dispatch_2.ListA)

smaller_than_7 = SmallerThan(FirstNumber=data_3, SecondNumber="299")  # -> SmallerThan, OrEqualTo
panel_30 = Panel(smaller_than_7.SmallerThan)
box_2 = Box(graft(list_item_4))  # disabled
dispatch_3 = Dispatch(List=new_desks_tops, DispatchPattern=panel_30)  # -> ListA, ListB
brep_4 = Brep(dispatch_3.ListA)

larger_than_5 = LargerThan(FirstNumber=data_3, SecondNumber="3001")  # -> LargerThan, OrEqualTo
panel_31 = Panel(larger_than_5.LargerThan)
box_3 = Box(graft(list_item_4))  # disabled
dispatch_4 = Dispatch(List=new_desks_tops, DispatchPattern=panel_31)  # -> ListA, ListB
brep_5 = Brep(dispatch_4.ListA)

end_points_6 = EndPoints(Curve=line_sdl_2)  # -> Start, End
end_points_7 = EndPoints(Curve=rotate_5.Geometry)  # -> Start, End
points_trim_curve = PointsTrimCurve(Curve=move_7.Geometry, Points=[end_points_6.End, end_points_7.End], Flip=True)  # -> Trimmed, SubDomains, Intersected
curve_13 = Curve(points_trim_curve.Trimmed)
join_curves_4 = JoinCurves(Curves=[join_curves_3, curve_13], Preserve=False)

list_item_27 = ListItem(List=join_curves_4, Index=1, Wrap=True)
surface_7 = Surface(list_item_27)

larger_than_6 = LargerThan(FirstNumber=panel_22, SecondNumber="95")  # -> LargerThan, OrEqualTo
panel_32 = Panel(larger_than_6.LargerThan)
dispatch_5 = Dispatch(List=surface_7, DispatchPattern=panel_32)  # -> ListA, ListB
brep_6 = Brep(dispatch_5.ListA)
brep_7 = Brep(dispatch_5.ListB)

unit_z_19 = UnitZ(Factor=0.1)
move_34 = Move(Geometry=brep_4, Motion=unit_z_19)  # -> Geometry, Transform
move_35 = Move(Geometry=brep_3, Motion=unit_z_19)  # -> Geometry, Transform
move_36 = Move(Geometry=brep_5, Motion=unit_z_19)  # -> Geometry, Transform
curve_14 = Curve(move_35.Geometry)
curve_15 = Curve(move_34.Geometry)
curve_16 = Curve(move_36.Geometry)

# ---- group: over given value
unit_z_20 = UnitZ(Factor=0.001)
move_37 = Move(Geometry=brep_6, Motion=unit_z_20)  # -> Geometry, Transform
curve_17 = Curve(move_37.Geometry)

# ---- group: under given value
unit_z_21 = UnitZ(Factor=0.001)
move_38 = Move(Geometry=brep_7, Motion=unit_z_21)  # -> Geometry, Transform
curve_18 = Curve(move_38.Geometry)

# ----
biurka_ktore_spelnily_lux = Panel(gate_and_2)
biurka_ktore_spelnily_glare = Panel(panel_32)
gate_and_3 = GateAnd(A=biurka_ktore_spelnily_lux, B=biurka_ktore_spelnily_glare)
biurka_ktore_spelnily_oba_wymagania = Panel(gate_and_3)
number = Number(biurka_ktore_spelnily_oba_wymagania)
score_per_desk = Panel("1")
data_4 = Data(flatten(number))
multiplication_8 = Multiplication(A=data_4, B=score_per_desk)
mass_addition = MassAddition(Input=multiplication_8)  # -> Result, PartialResults
number_2 = Number(mass_addition.Result)
achieved_score = Panel(number_2)

stream_filter_11 = StreamFilter(Gate=boolean, Stream0=surface_4, Stream1=stream_filter_5)
stream_filter_12 = StreamFilter(Gate=boolean, Stream0=surface_4, Stream1=move_28.Geometry)
stream_filter_13 = StreamFilter(Gate=boolean, Stream0=surface_4, Stream1=stream_filter_4)
stream_filter_14 = StreamFilter(Gate=boolean, Stream0=surface_4, Stream1=list_item_24)
mesh_colours_3 = MeshColours(Mesh=move_36.Geometry, Colours=colour_swatch_3)
mesh_colours_4 = MeshColours(Mesh=move_35.Geometry, Colours=colour_swatch_4)
mesh_colours_5 = MeshColours(Mesh=move_34.Geometry, Colours=colour_swatch_2)
mesh_colours_6 = MeshColours(Mesh=move_38.Geometry, Colours=ColourSwatch(SwatchColor=RGB(219, 66, 66)))
mesh_colours_7 = MeshColours(Mesh=move_37.Geometry, Colours=ColourSwatch(SwatchColor=RGB(175, 219, 61)))

division_5 = Division(A=achieved_score, B=max_score)
multiplication_9 = Multiplication(A=division_5, B="100")
round_to_decimal_place_5 = RoundToDecimalPlace(NumberX=multiplication_9, DecimalPlace="0", RoundType=0)  # -> Rounded, Difference
achieved_score_in = Panel(round_to_decimal_place_5.Rounded)

# ---- group: RH_OUT:grid_daylight
mesh_23 = Mesh(flatten(stream_filter_14))

# ---- group: RH_OUT:grid_glare
mesh_24 = Mesh(flatten(stream_filter_12))

# ---- group: RH_OUT:values_glare
number_3 = Number(flatten(stream_filter_13))

# ---- group: RH_OUT:values_daylight
number_4 = Number(flatten(stream_filter_11))

# ----
text_13 = Panel("Dobrze oświetlone biurka : ")
text_14 = Panel("/")
merge_10 = Merge(Data1=text_13, Data2=achieved_score, Data3=text_14, Data4=max_score)

text_15 = Panel("%")
text_16 = Panel("Uzyskany wynik : ")
text_17 = Text(achieved_score_in)
merge_11 = Merge(Data1=text_16, Data2=text_17, Data3=text_15, Data4=merge_10)

colour_swatch_5 = ColourSwatch(SwatchColor=RGB(0, 0, 0))
text_join_4 = TextJoin(Text=merge_11)
colour = Colour(ColourSwatch(SwatchColor=RGB(0, 21, 97)))

# ---- group: alternative grid
mesh_explode_4 = MeshExplode(Mesh=heatmap.mesh, Interpolate=False)
smaller_than_8 = SmallerThan(FirstNumber=godzin_bez_glare, SecondNumber="95")  # -> SmallerThan, OrEqualTo
mesh_25 = Mesh(mesh_explode_4)
dispatch_6 = Dispatch(List=mesh_25, DispatchPattern=smaller_than_8.SmallerThan)  # -> ListA, ListB
mesh_26 = Mesh(dispatch_6.ListA)
mesh_27 = Mesh(dispatch_6.ListB)

# ---- group: bypass errors - if there is no mesh grid, pass nothing
list_item_28 = ListItem(List=flatten(mesh_27), Index=0, Wrap=True)
null_item_8 = NullItem(Item=flatten(list_item_28))  # -> NullFlags, InvalidFlags, Description
stream_filter_15 = StreamFilter(Gate=null_item_8.InvalidFlags, Stream0=mesh_27)

list_item_29 = ListItem(List=flatten(mesh_26), Index=0, Wrap=True)
null_item_9 = NullItem(Item=flatten(list_item_29))  # -> NullFlags, InvalidFlags, Description
stream_filter_16 = StreamFilter(Gate=null_item_9.InvalidFlags, Stream0=mesh_26)

# ---- group: alternative grid (continued)
mesh_colours_8 = MeshColours(Mesh=stream_filter_15, Colours=ColourSwatch(SwatchColor=RGB(175, 219, 61)))
mesh_colours_9 = MeshColours(Mesh=stream_filter_16, Colours=ColourSwatch(SwatchColor=RGB(219, 66, 66)))

# ---- group: mesh - grid
deconstruct_mesh_5 = DeconstructMesh(Mesh=mesh_colours_9)  # -> Vertices, Faces, Colours, Normals
construct_mesh_5 = ConstructMesh(Vertices=deconstruct_mesh_5.Vertices, Faces=deconstruct_mesh_5.Faces)
unit_z_22 = UnitZ(Factor=0)
move_39 = Move(Geometry=construct_mesh_5, Motion=unit_z_22)  # -> Geometry, Transform

deconstruct_mesh_6 = DeconstructMesh(Mesh=mesh_colours_8)  # -> Vertices, Faces, Colours, Normals
construct_mesh_6 = ConstructMesh(Vertices=deconstruct_mesh_6.Vertices, Faces=deconstruct_mesh_6.Faces)
unit_z_23 = UnitZ(Factor=0)
move_40 = Move(Geometry=construct_mesh_6, Motion=unit_z_23)  # -> Geometry, Transform

# ----
unit_y_5 = UnitY(Factor=1)
curve_19 = Curve()
angle_3 = Angle(VectorA=curve_19, VectorB=unit_y_5)  # -> Angle, Reflex
degrees_3 = Degrees(Radians=angle_3.Angle)
round_to_decimal_place_6 = RoundToDecimalPlace(NumberX=degrees_3, DecimalPlace=0, RoundType=0)  # -> Rounded, Difference

equality_2 = Equality(FirstNumber="180", SecondNumber=round_to_decimal_place_6.Rounded)  # -> Equality, Inequality
equality_3 = Equality(FirstNumber="0", SecondNumber=round_to_decimal_place_6.Rounded)  # -> Equality, Inequality
equality_4 = Equality(FirstNumber="90", SecondNumber=round_to_decimal_place_6.Rounded)  # -> Equality, Inequality
equality_5 = Equality(FirstNumber="270", SecondNumber=round_to_decimal_place_6.Rounded)  # -> Equality, Inequality
number_5 = Number(equality_2.Equality)
number_6 = Number(equality_3.Equality)
number_7 = Number(equality_4.Equality)
number_8 = Number(equality_5.Equality)
multiplication_10 = Multiplication(A="0", B=number_5)
multiplication_11 = Multiplication(A="0", B=number_6)
multiplication_12 = Multiplication(A="90", B=number_7)
multiplication_13 = Multiplication(A="90", B=number_8)
addition_3 = Addition(A=multiplication_10, B=multiplication_11, C=multiplication_12, D=multiplication_13)

rotate_6 = Rotate(Geometry=move_32.Geometry, Angle=graft(degrees(addition_3)), Plane=area_7.Centroid)  # -> Geometry, Transform

# ---- group: RH_OUT:text
mesh_28 = Mesh(flatten(rotate_6.Geometry))

# ----
unit_y_6 = UnitY(Factor=1)
curve_20 = Curve()
angle_4 = Angle(VectorA=curve_20, VectorB=unit_y_6)  # -> Angle, Reflex
degrees_4 = Degrees(Radians=angle_4.Angle)
round_to_decimal_place_7 = RoundToDecimalPlace(NumberX=degrees_4, DecimalPlace=0, RoundType=0)  # -> Rounded, Difference

equality_6 = Equality(FirstNumber="180", SecondNumber=round_to_decimal_place_7.Rounded)  # -> Equality, Inequality
equality_7 = Equality(FirstNumber="0", SecondNumber=round_to_decimal_place_7.Rounded)  # -> Equality, Inequality
equality_8 = Equality(FirstNumber="90", SecondNumber=round_to_decimal_place_7.Rounded)  # -> Equality, Inequality
equality_9 = Equality(FirstNumber="270", SecondNumber=round_to_decimal_place_7.Rounded)  # -> Equality, Inequality
number_9 = Number(equality_6.Equality)
number_10 = Number(equality_7.Equality)
number_11 = Number(equality_8.Equality)
number_12 = Number(equality_9.Equality)
multiplication_14 = Multiplication(A="0", B=number_9)
multiplication_15 = Multiplication(A="0", B=number_10)
multiplication_16 = Multiplication(A="90", B=number_11)
multiplication_17 = Multiplication(A="90", B=number_12)
addition_4 = Addition(A=multiplication_14, B=multiplication_15, C=multiplication_16, D=multiplication_17)

rotate_7 = Rotate(Geometry=move_33.Geometry, Angle=graft(degrees(addition_4)), Plane=area_9.Centroid)  # -> Geometry, Transform

bounding_box_5 = BoundingBox(Content=rotate_7.Geometry, Plane=PlaneXY(0, 0, 0), UnionBox=True)  # -> Box, Box_2; disabled
deconstruct_brep_10 = DeconstructBrep(Brep=bounding_box_5.Box)  # -> Faces, Edges, Vertices; disabled
list_item_30 = ListItem(List=deconstruct_brep_10.Vertices, Index=0, Wrap=True)  # disabled

mesh_29 = Mesh(flip_matrix_2)
dispatch_7 = Dispatch(List=mesh_29, DispatchPattern=biurka_ktore_spelnily_oba_wymagania)  # -> ListA, ListB
mesh_30 = Mesh(dispatch_7.ListA)
mesh_31 = Mesh(dispatch_7.ListB)

# ---- group: bypass errors - if there is no mesh grid, pass 1 face mesh
list_item_31 = ListItem(List=flatten(mesh_30), Index=0, Wrap=True)
null_item_10 = NullItem(Item=flatten(list_item_31))  # -> NullFlags, InvalidFlags, Description
unit_z_24 = UnitZ(Factor="-.1")
move_41 = Move(Geometry=floor, Motion=unit_z_24)  # -> Geometry, Transform
stream_filter_17 = StreamFilter(Gate=null_item_10.InvalidFlags, Stream0=mesh_30, Stream1=move_41.Geometry)

list_item_32 = ListItem(List=flatten(mesh_31), Index=0, Wrap=True)
null_item_11 = NullItem(Item=flatten(list_item_32))  # -> NullFlags, InvalidFlags, Description
unit_z_25 = UnitZ(Factor="-.1")
move_42 = Move(Geometry=floor, Motion=unit_z_25)  # -> Geometry, Transform
stream_filter_18 = StreamFilter(Gate=null_item_11.InvalidFlags, Stream0=mesh_31, Stream1=move_42.Geometry)

# ----
mesh_colours_10 = MeshColours(Mesh=stream_filter_17, Colours=ColourSwatch(SwatchColor=RGB(175, 219, 61)))
mesh_colours_11 = MeshColours(Mesh=stream_filter_18, Colours=ColourSwatch(SwatchColor=RGB(219, 66, 66)))

# ---- group: mesh - grid
deconstruct_mesh_7 = DeconstructMesh(Mesh=mesh_colours_10)  # -> Vertices, Faces, Colours, Normals
construct_mesh_7 = ConstructMesh(Vertices=deconstruct_mesh_7.Vertices, Faces=deconstruct_mesh_7.Faces)
unit_z_26 = UnitZ(Factor=0)
move_43 = Move(Geometry=construct_mesh_7, Motion=unit_z_26)  # -> Geometry, Transform

deconstruct_mesh_8 = DeconstructMesh(Mesh=mesh_colours_11)  # -> Vertices, Faces, Colours, Normals
construct_mesh_8 = ConstructMesh(Vertices=deconstruct_mesh_8.Vertices, Faces=deconstruct_mesh_8.Faces)
unit_z_27 = UnitZ(Factor=0)
move_44 = Move(Geometry=construct_mesh_8, Motion=unit_z_27)  # -> Geometry, Transform

# ----
mesh_colours_12 = MeshColours(Mesh=move_43.Geometry, Colours=deconstruct_mesh_7.Colours)
mesh_colours_13 = MeshColours(Mesh=move_44.Geometry, Colours=deconstruct_mesh_8.Colours)

mesh_32 = Mesh(flatten(rotate_7.Geometry))
mesh_33 = Mesh(flatten(mesh_colours_5))
mesh_34 = Mesh(flatten(mesh_colours_4))
mesh_35 = Mesh(flatten(mesh_colours_3))
mesh_36 = Mesh(flatten(mesh_colours_12))
mesh_37 = Mesh(flatten(mesh_colours_13))
mesh_38 = Mesh(flatten(mesh_colours_7))
mesh_39 = Mesh(flatten(mesh_colours_6))
